# Grasshopper definition final_project.gh (Grasshopper 1.0.7)

number_slider = Slider(4.5, range=0..10)
number_slider_2 = Slider(6, range=0..10)
number_slider_3 = Slider(0.43, range=0..1)
number_slider_4 = Slider(0.32, range=0..1)
unit_x = UnitX(Factor=1)
unit_z = UnitZ(Factor=1)
unit_x_2 = UnitX(Factor=1)
domain_box = DomainBox(Base=PlaneXY(0, 0, 0), X=number_slider_2, Y=number_slider, Z=Slider(0.5, range=0..1))
domain_box_2 = DomainBox(Base=PlaneXY(0, 0, 0), X=number_slider_2, Y=number_slider, Z=Slider(1, range=0..1))
amplitude = Amplitude(Vector=unit_x, Amplitude=number_slider_3)
amplitude_2 = Amplitude(Vector=unit_z, Amplitude=Slider(0.125, range=0..1))
amplitude_3 = Amplitude(Vector=unit_x_2, Amplitude=expr("-x", Slider(7, range=0..10)))
panel = Panel("MAGNET HOLE DEPTH")
fillet_edge = FilletEdge(Shape=domain_box_2, Blend=0, Metric=0, Edges=[8, 9, 10, 11], Radii=number_slider_4)
move = Move(Geometry=domain_box, Motion=amplitude_3)  # -> Geometry, Transform
panel_2 = Panel("MAGNET HOLE RADIUS")
unit_z_2 = UnitZ(Factor=1)
unit_z_3 = UnitZ(Factor=1)
brep = Brep(fillet_edge)
brep_2 = Brep(move.Geometry)
amplitude_4 = Amplitude(Vector=unit_z_2, Amplitude=Slider(0.5, range=0..1))
number_slider_5 = Slider(0.13, range=0..1)
deconstruct_brep = DeconstructBrep(Brep=brep)  # -> Faces, Edges, Vertices
list_item = ListItem(List=deconstruct_brep.Edges, Index=Slider(4, range=0..10), Wrap=True)
list_item_2 = ListItem(List=deconstruct_brep.Edges, Index=Slider(7, range=0..10), Wrap=True)
list_item_3 = ListItem(List=deconstruct_brep.Edges, Index=Slider(5, range=0..10), Wrap=True)
move_2 = Move(Geometry=list_item, Motion=expr("-x", amplitude_2))  # -> Geometry, Transform
move_3 = Move(Geometry=list_item_3, Motion=expr("-x", amplitude))  # -> Geometry, Transform
move_4 = Move(Geometry=list_item_2, Motion=amplitude)  # -> Geometry, Transform
list_item_4 = ListItem(List=deconstruct_brep.Edges, Index=Slider(7, range=0..10), Wrap=True)
list_item_5 = ListItem(List=deconstruct_brep.Edges, Index=Slider(5, range=0..10), Wrap=True)
list_item_6 = ListItem(List=deconstruct_brep.Edges, Index=Slider(2, range=0..10), Wrap=True)
point_on_curve = PointOnCurve(move_4.Geometry, parameter=0.902)
point_on_curve_2 = PointOnCurve(move_3.Geometry, parameter=0.098)
curve_middle = CurveMiddle(Curve=list_item_4)
curve_middle_2 = CurveMiddle(Curve=list_item_5)
point_on_curve_3 = PointOnCurve(list_item_5, parameter=0.5)
fillet_edge_2 = FilletEdge(Shape=brep_2, Blend=0, Metric=0, Edges=[4, 5, 6, 7, 8, 9, 10, 11], Radii=Slider(0.32, range=0..1))
evaluate_length = EvaluateLength(Curve=move_2.Geometry, Length=expr("1-x", Slider(0.1, range=0..1)), Normalized=True)  # -> Point, Tangent, Parameter
evaluate_length_2 = EvaluateLength(Curve=move_2.Geometry, Length=expr("1-x", Slider(0.2, range=0..1)), Normalized=True)  # -> Point, Tangent, Parameter
circle_cnr = CircleCNR(Center=[point_on_curve_2, point_on_curve], Normal=Vector(0, 0, 1), Radius=number_slider_5)
amplitude_5 = Amplitude(Vector=expr("-x", unit_z_3), Amplitude=Slider(0.12, range=0..1))
move_5 = Move(Geometry=list_item_6, Motion=amplitude_4)  # -> Geometry, Transform
list_item_7 = ListItem(List=deconstruct_brep.Faces, Index=Slider(2, range=0..10), Wrap=True)
line = Line(StartPoint=curve_middle_2, EndPoint=curve_middle)
list_item_8 = ListItem(List=deconstruct_brep.Edges, Index=Slider(4, range=0..10), Wrap=True)
brep_3 = Brep(fillet_edge_2)
unit_z_4 = UnitZ(Factor=1)
number_slider_6 = Slider(0.13, range=0..1)
extrude = Extrude(Base=circle_cnr, Direction=amplitude_5)
unit_z_5 = UnitZ(Factor=1)
brep_edges = BrepEdges(Brep=list_item_7)  # -> Naked, Interior, NonManifold
unit_y = UnitY(Factor=1)
deconstruct_brep_2 = DeconstructBrep(Brep=brep_3)  # -> Faces, Edges, Vertices
unit_x_3 = UnitX(Factor=1)
ellipse = Ellipse(Plane=circle_cnr, Radius1=expr("X+0.01", number_slider_5), Radius2=expr("X/2", number_slider_5))  # -> Ellipse, Focus1, Focus2
point_on_curve_4 = PointOnCurve(move_5.Geometry, parameter=0.5)
unit_y_2 = UnitY(Factor=1)
divide_surface = DivideSurface(Surface=list_item_7, UCount=Slider(3, range=0..10), VCount=Slider(4, range=0..10))  # -> flatten(Points), Normals, Parameters
amplitude_6 = Amplitude(Vector=unit_z_4, Amplitude=Slider(0.125, range=0..1))
amplitude_7 = Amplitude(Vector=unit_z_5, Amplitude=expr("-x", Slider(1, range=0..1)))
cap_holes = CapHoles(Brep=extrude)
move_6 = Move(Geometry=list_item_8, Motion=expr("-x", amplitude_6))  # -> Geometry, Transform
list_item_9 = ListItem(List=deconstruct_brep_2.Edges, Index=Slider(0, range=0..10), Wrap=True)
join_curves = JoinCurves(Curves=brep_edges.Naked, Preserve=False)
amplitude_8 = Amplitude(Vector=unit_x_3, Amplitude=number_slider_3)
circle_cnr_2 = CircleCNR(Center=point_on_curve_4, Normal=unit_y, Radius=number_slider_6)
list_item_10 = ListItem(List=deconstruct_brep_2.Edges, Index=Slider(1, range=0..20), Wrap=True)
list_item_11 = ListItem(List=deconstruct_brep_2.Edges, Index=Slider(3, range=0..20), Wrap=True)
number_slider_7 = Slider(5, range=0..10)
number_slider_8 = Slider(0.44, range=0..1)
number_slider_9 = Slider(0.3, range=0..1)
amplitude_9 = Amplitude(Vector=unit_y_2, Amplitude=Slider(0.33, range=0..1))
# RADIUS OF LED CIRCLES AND ELLIPSES
number_slider_10 = Slider(0.13, range=0..1)
extrude_2 = Extrude(Base=ellipse.Ellipse, Direction=amplitude_7)
point_in_curve = PointInCurve(Point=divide_surface.Points, Curve=join_curves)  # -> Relationship, Point
move_7 = Move(Geometry=list_item_10, Motion=expr("-x", amplitude_8))  # -> Geometry, Transform
move_8 = Move(Geometry=list_item_11, Motion=amplitude_8)  # -> Geometry, Transform
unit_z_6 = UnitZ(Factor=1)
unit_y_3 = UnitY(Factor=1)
extrude_3 = Extrude(Base=circle_cnr_2, Direction=expr("-x", amplitude_9))
subtraction = Subtraction(A=number_slider_7, B=number_slider_8)
ellipse_2 = Ellipse(Plane=circle_cnr_2, Radius1=expr("x/2", number_slider_6), Radius2=expr("x+0.01", number_slider_6))  # -> Ellipse, Focus1, Focus2
cap_holes_2 = CapHoles(Brep=extrude_2)
addition = Addition(A=number_slider_9, B=number_slider_8)
subtraction_2 = Subtraction(B=Slider(0.125, range=0..1))
equality = Equality(FirstNumber=point_in_curve.Relationship, SecondNumber=1)  # -> Equality, Inequality
number_slider_11 = Slider(0.44, range=0..1)
point_on_curve_5 = PointOnCurve(move_8.Geometry, parameter=0.097)
unit_z_7 = UnitZ(Factor=1)
amplitude_10 = Amplitude(Vector=unit_z_6, Amplitude=expr("-x", subtraction_2))
move_9 = Move(Geometry=list_item_9, Motion=expr("-x", amplitude_10))  # -> Geometry, Transform
point_on_curve_6 = PointOnCurve(move_7.Geometry, parameter=0.906)
number_slider_12 = Slider(5, range=0..10)
evaluate_length_3 = EvaluateLength(Curve=move_6.Geometry, Length=number_slider_7, Normalized=False)  # -> Point, Tangent, Parameter
evaluate_length_4 = EvaluateLength(Curve=move_6.Geometry, Length=subtraction, Normalized=False)  # -> Point, Tangent, Parameter
amplitude_11 = Amplitude(Vector=unit_y_3, Amplitude=Slider(0.5, range=0..1))
unit_z_8 = UnitZ(Factor=1)
evaluate_length_5 = EvaluateLength(Curve=move_6.Geometry, Length=addition, Normalized=False)  # -> Point, Tangent, Parameter
evaluate_length_6 = EvaluateLength(Curve=move_6.Geometry, Length=number_slider_9, Normalized=False)  # -> Point, Tangent, Parameter
cap_holes_3 = CapHoles(Brep=extrude_3)
number_slider_13 = Slider(0.3, range=0..10)
amplitude_12 = Amplitude(Vector=expr("-x", unit_z_7), Amplitude=Slider(1.3, range=0..10))
extrude_4 = Extrude(Base=ellipse_2.Ellipse, Direction=expr("-x", amplitude_11))
circle_cnr_3 = CircleCNR(Center=[point_on_curve_6, point_on_curve_5], Normal=Vector(0, 0, 1), Radius=number_slider_5)
amplitude_13 = Amplitude(Vector=expr("-x", unit_z_8), Amplitude=Slider(0.33, range=0..1))
cull_pattern = CullPattern(List=divide_surface.Points, CullPattern=equality.Inequality)
pull_point = PullPoint(Point=cull_pattern, Geometry=line, ClosestOnly=True)  # -> flatten(ClosestPoint), Distance
circle_cnr_4 = CircleCNR(Center=pull_point.ClosestPoint, Normal=Vector(0, 0, 1), Radius=number_slider_10)
ellipse_3 = Ellipse(Plane=circle_cnr_4, Radius1=expr("x+0.01", number_slider_10), Radius2=expr("x/2", number_slider_10))  # -> Ellipse, Focus1, Focus2
addition_2 = Addition(A=number_slider_13, B=number_slider_11)
subtraction_3 = Subtraction(A=number_slider_12, B=number_slider_11)
extrude_5 = Extrude(Base=ellipse_3.Ellipse, Direction=amplitude_12)
extrude_6 = Extrude(Base=circle_cnr_3, Direction=expr("-x", amplitude_5))
extrude_7 = Extrude(Base=circle_cnr_4, Direction=amplitude_13)
unit_y_4 = UnitY(Factor=1)
unit_y_5 = UnitY(Factor=1)
cap_holes_4 = CapHoles(Brep=extrude_4)
evaluate_length_7 = EvaluateLength(Curve=move_9.Geometry, Length=addition_2, Normalized=False)  # -> Point, Tangent, Parameter
evaluate_length_8 = EvaluateLength(Curve=move_9.Geometry, Length=number_slider_13, Normalized=False)  # -> Point, Tangent, Parameter
evaluate_length_9 = EvaluateLength(Curve=move_9.Geometry, Length=number_slider_12, Normalized=False)  # -> Point, Tangent, Parameter
evaluate_length_10 = EvaluateLength(Curve=move_9.Geometry, Length=subtraction_3, Normalized=False)  # -> Point, Tangent, Parameter
cap_holes_5 = CapHoles(Brep=extrude_5)
set_difference = SetDifference(SetA=cull_pattern, SetB=pull_point.ClosestPoint)
cap_holes_6 = CapHoles(Brep=extrude_6)
cap_holes_7 = CapHoles(Brep=extrude_7)
deconstruct_brep_3 = DeconstructBrep(Brep=cap_holes_4)  # -> Faces, Edges, Vertices
circle_cnr_5 = CircleCNR(Center=[evaluate_length_6.Point, evaluate_length_5.Point], Normal=unit_y_4, Radius=Slider(0.035, range=0..0.1))
circle_cnr_6 = CircleCNR(Center=[evaluate_length_4.Point, evaluate_length_3.Point], Normal=unit_y_5, Radius=Slider(0.035, range=0..0.1))
panel_3 = Panel("RADIUS OF SPHERE")
solid_difference = SolidDifference(BrepsA=brep, BrepsB=cap_holes_7)
solid_difference_2 = SolidDifference(BrepsA=brep_3, BrepsB=cap_holes_6)
unit_y_6 = UnitY(Factor=1)
unit_y_7 = UnitY(Factor=1)
sphere = Sphere(Base=set_difference, Radius=Slider(0.8, range=0..1))
unit_y_8 = UnitY(Factor=1)
list_item_12 = ListItem(List=deconstruct_brep_3.Faces, Index=Slider(1, range=0..10), Wrap=True)
unit_y_9 = UnitY(Factor=1)
brep_4 = Brep(solid_difference_2)
solid_difference_3 = SolidDifference(BrepsA=solid_difference, BrepsB=cap_holes_5)
area = Area(Geometry=list_item_12)  # -> Area, Centroid
panel_4 = Panel("RADIUS OF HOLES")
amplitude_14 = Amplitude(Vector=unit_y_6, Amplitude=Slider(0.098, range=0..0.1))
extrude_8 = Extrude(Base=circle_cnr_5, Direction=amplitude_14)
amplitude_15 = Amplitude(Vector=unit_y_7, Amplitude=Slider(0.098, range=0..0.1))
extrude_9 = Extrude(Base=circle_cnr_6, Direction=amplitude_15)
solid_difference_4 = SolidDifference(BrepsA=solid_difference_3, BrepsB=sphere)
unit_z_9 = UnitZ(Factor=1)
circle_cnr_7 = CircleCNR(Center=[evaluate_length_7.Point, evaluate_length_8.Point], Normal=unit_y_8, Radius=Slider(0.035, range=0..0.1))
circle_cnr_8 = CircleCNR(Center=[evaluate_length_10.Point, evaluate_length_9.Point], Normal=unit_y_9, Radius=Slider(0.035, range=0..0.1))
ellipse_4 = Ellipse(Plane=area.Centroid, Radius1=expr("x+0.01", number_slider_6), Radius2=expr("x/2", number_slider_6))  # -> Ellipse, Focus1, Focus2
unit_z_10 = UnitZ(Factor=1)
unit_y_10 = UnitY(Factor=1)
cap_holes_8 = CapHoles(Brep=extrude_8)
unit_y_11 = UnitY(Factor=1)
cap_holes_9 = CapHoles(Brep=extrude_9)
amplitude_16 = Amplitude(Vector=unit_z_9, Amplitude=Slider(2, range=0..10))
solid_difference_5 = SolidDifference(BrepsA=solid_difference_4, BrepsB=cap_holes)
amplitude_17 = Amplitude(Vector=unit_z_10, Amplitude=expr("x/2", number_slider_6))
amplitude_18 = Amplitude(Vector=unit_y_10, Amplitude=Slider(0.098, range=0..0.1))
extrude_10 = Extrude(Base=circle_cnr_7, Direction=amplitude_18)
amplitude_19 = Amplitude(Vector=unit_y_11, Amplitude=Slider(0.098, range=0..0.1))
extrude_11 = Extrude(Base=circle_cnr_8, Direction=amplitude_19)
number_slider_14 = Slider(0.5, range=0..1)
extrude_12 = Extrude(Base=ellipse_4.Ellipse, Direction=expr("-x", amplitude_16))
solid_difference_6 = SolidDifference(BrepsA=solid_difference_5, BrepsB=cap_holes_2)
extrude_13 = Extrude(Base=ellipse_4.Ellipse, Direction=amplitude_17)
number_slider_15 = Slider(0.75, range=0..1)
cap_holes_10 = CapHoles(Brep=extrude_10)
cap_holes_11 = CapHoles(Brep=extrude_11)
cap_holes_12 = CapHoles(Brep=extrude_13)
cap_holes_13 = CapHoles(Brep=extrude_12)
negative = Negative(Value=number_slider_15)
solid_difference_7 = SolidDifference(BrepsA=brep_4, BrepsB=cap_holes_10)
solid_union = SolidUnion(Breps=[cap_holes_12, cap_holes_4, cap_holes_13, cap_holes_3])  # -> flatten(Result)
domain_box_3 = DomainBox(Base=PlaneXY(0, 0, 0), X=number_slider_2, Y=number_slider, Z=negative)
solid_difference_8 = SolidDifference(BrepsA=solid_difference_7, BrepsB=cap_holes_11)
fillet_edge_3 = FilletEdge(Shape=domain_box_3, Blend=0, Metric=0, Edges=[0, 1, 2, 3, 8, 9, 10, 11], Radii=number_slider_4)
brep_5 = Brep(solid_difference_8)
brep_6 = Brep(fillet_edge_3)
unit_z_11 = UnitZ(Factor=1)
deconstruct_brep_4 = DeconstructBrep(Brep=brep_6)  # -> Faces, Edges, Vertices
addition_3 = Addition(A=number_slider_15, B=Slider(0.1, range=0..0.1))
amplitude_20 = Amplitude(Vector=unit_z_11, Amplitude=addition_3)
list_item_13 = ListItem(List=deconstruct_brep_4.Faces, Index=Slider(5, range=0..10), Wrap=True)
list_item_14 = ListItem(List=deconstruct_brep_4.Faces, Index=Slider(7, range=0..10), Wrap=True)
extrude_14 = Extrude(Base=list_item_13, Direction=amplitude_20)
area_2 = Area(Geometry=list_item_14)  # -> Area, Centroid
cap_holes_14 = CapHoles(Brep=extrude_14)
deconstruct_brep_5 = DeconstructBrep(Brep=list_item_13)  # -> Faces, Edges, Vertices
solid_difference_9 = SolidDifference(BrepsA=brep_6, BrepsB=cap_holes_14)
center_box = CenterBox(Base=area_2.Centroid, X=1, Y=Slider(0.13, range=0..1), Z=Slider(0.06, range=0..0.1))
solid_difference_10 = SolidDifference(BrepsA=solid_difference_9, BrepsB=center_box)
brep_7 = Brep(solid_difference_6)
brep_8 = Brep(solid_difference_10)
brep_join = BrepJoin(Breps=[brep_7, brep_8])  # -> flatten(Breps), Closed
brep_9 = Brep(brep_join.Breps)
solid_difference_11 = SolidDifference(BrepsA=brep_9, BrepsB=cap_holes_8)
solid_difference_12 = SolidDifference(BrepsA=solid_difference_11, BrepsB=cap_holes_9)
solid_difference_13 = SolidDifference(BrepsA=solid_difference_12, BrepsB=solid_union)
