# Grasshopper definition mancala.gh (Grasshopper 1.0.7)

number_slider = Slider(1.035, range=0..10)
number_slider_2 = Slider(14, range=0..20)
number_slider_3 = Slider(5, range=0..10)
domain_box = DomainBox(Base=PlaneXY(0, 0, 0), X=number_slider_3, Y=number_slider_2, Z=number_slider)
division = Division(A=number_slider, B=Slider(1.5, range=0..10))
deconstruct_brep = DeconstructBrep(Brep=domain_box)  # -> Faces, Edges, Vertices
domain_box_2 = DomainBox(Base=PlaneXY(0, 0, 0), X=number_slider_3, Y=number_slider_2, Z=division)
vector_xyz = VectorXYZ(XComponent=Slider(8, range=0..100), YComponent=Slider(0, range=0..100), ZComponent=Slider(0, range=0..100))  # -> Vector, Length
move = Move(Geometry=domain_box_2, Motion=vector_xyz.Vector)  # -> Geometry, Transform
fillet_edge = FilletEdge(Shape=domain_box, Blend=2, Metric=2, Edges=[0, 1, 2, 3, 4, 5, 6, 7, 8, 9, 10, 11], Radii=Slider(0.27, range=0..1))
deconstruct_brep_2 = DeconstructBrep(Brep=move.Geometry)  # -> Faces, Edges, Vertices
deconstruct_brep_3 = DeconstructBrep(Brep=fillet_edge)  # -> Faces, Edges, Vertices
fillet_edge_2 = FilletEdge(Shape=move.Geometry, Blend=2, Metric=2, Edges=[0, 1, 2, 3, 4, 5, 6, 7, 8, 9, 10, 11], Radii=Slider(0.29, range=0..1))
deconstruct_brep_4 = DeconstructBrep(Brep=move.Geometry)  # -> Faces, Edges, Vertices
list_item = ListItem(List=deconstruct_brep_3.Faces, Index=Slider(5, range=0..7), Wrap=True)
number_slider_4 = Slider(8, range=0..10)
number_slider_5 = Slider(3, range=0..10)
list_item_2 = ListItem(List=deconstruct_brep_2.Edges, Index=Slider(7, range=0..12), Wrap=True)
divide_surface = DivideSurface(Surface=list_item, UCount=number_slider_5, VCount=number_slider_4)  # -> flatten(Points), Normals, Parameters
number_slider_6 = Slider(0.24, range=0..1)
offset_curve = OffsetCurve(Curve=list_item_2, Distance=Slider(0.42, range=0..1), Corners=1)
offset_curve_2 = OffsetCurve(Curve=offset_curve, Distance=Slider(0.31, range=0..1), Corners=1)
unit_z = UnitZ(Factor=1)
unit_z_2 = UnitZ(Factor=1)
amplitude = Amplitude(Vector=unit_z, Amplitude=expr("-x", number_slider_6))
amplitude_2 = Amplitude(Vector=unit_z_2, Amplitude=expr("-x", number_slider_6))
sphere = Sphere(Base=divide_surface.Points, Radius=Slider(0.785, range=0..1))
extrude = Extrude(Base=offset_curve, Direction=amplitude_2)
extrude_2 = Extrude(Base=offset_curve_2, Direction=amplitude)
list_item_3 = ListItem(List=deconstruct_brep_3.Faces, Index=Slider(4, range=0..10), Wrap=True)
solid_difference = SolidDifference(BrepsA=fillet_edge, BrepsB=sphere)
brep = Brep(solid_difference)
deconstruct_brep_5 = DeconstructBrep(Brep=extrude)  # -> Faces, Edges, Vertices
deconstruct_brep_6 = DeconstructBrep(Brep=extrude_2)  # -> Faces, Edges, Vertices
divide_surface_2 = DivideSurface(Surface=list_item_3, UCount=number_slider_4, VCount=number_slider_5)  # -> flatten(Points), Normals, Parameters
join_curves = JoinCurves(Curves=deconstruct_brep_5.Edges, Preserve=False)
join_curves_2 = JoinCurves(Curves=deconstruct_brep_6.Edges, Preserve=False)
unit_z_3 = UnitZ(Factor=1)
brep_2 = Brep(fillet_edge_2)
list_item_4 = ListItem(List=deconstruct_brep.Edges, Index=Slider(31, range=0..100), Wrap=True)
loft = Loft(
    Curves=flatten([join_curves, join_curves_2]),
    Options={Adjust=False, Closed=False, LoftEnds=0, LoftSimp=0, LoftType=0, Rebuild=10, Refit=0.01})
number_slider_7 = Slider(0.35, range=0..1)
line_sdl = LineSDL(Start=divide_surface_2.Points, Direction=unit_z_3, Length=Slider(2, range=0..10))
cap_holes = CapHoles(Brep=loft)
pipe = Pipe(Curve=line_sdl, Radius=Slider(0.15, range=0..1), Caps=0)  # -> flatten(Pipe)
solid_difference_2 = SolidDifference(BrepsA=brep_2, BrepsB=cap_holes)
offset_curve_3 = OffsetCurve(Curve=list_item_4, Distance=expr("x", number_slider_7), Corners=1)
cap_holes_2 = CapHoles(Brep=pipe)
brep_3 = Brep(solid_difference_2)
deconstruct_brep_7 = DeconstructBrep(Brep=solid_difference_2)  # -> Faces, Edges, Vertices
point_on_curve = PointOnCurve(offset_curve_3, parameter=0.75)
point_on_curve_2 = PointOnCurve(offset_curve_3, parameter=0.25)
solid_difference_3 = SolidDifference(BrepsA=solid_difference, BrepsB=cap_holes_2)
list_item_5 = ListItem(List=deconstruct_brep_7.Edges, Index=Slider(17, range=0..100), Wrap=True)
number_slider_8 = Slider(0.1181, range=0..10)
offset_curve_4 = OffsetCurve(Curve=list_item_5, Distance=number_slider_7, Corners=1)
circle_cnr = CircleCNR(Center=point_on_curve, Normal=Vector(0, 0, 1), Radius=number_slider_8)
circle_cnr_2 = CircleCNR(Center=point_on_curve_2, Normal=Vector(0, 0, 1), Radius=number_slider_8)
join_curves_3 = JoinCurves(Curves=[circle_cnr_2, circle_cnr], Preserve=False)
point_on_curve_3 = PointOnCurve(offset_curve_4, parameter=0.25)
point_on_curve_4 = PointOnCurve(offset_curve_4, parameter=0.75)
unit_z_4 = UnitZ(Factor=1)
number_slider_9 = Slider(0.1181, range=0..10)
amplitude_3 = Amplitude(Vector=unit_z_4, Amplitude=expr("-x", Slider(0.11811, range=0..1)))
circle_cnr_3 = CircleCNR(Center=point_on_curve_4, Normal=Vector(0, 0, 1), Radius=number_slider_9)
circle_cnr_4 = CircleCNR(Center=point_on_curve_3, Normal=Vector(0, 0, 1), Radius=number_slider_9)
join_curves_4 = JoinCurves(Curves=[circle_cnr_4, circle_cnr_3], Preserve=False)
extrude_3 = Extrude(Base=join_curves_3, Direction=amplitude_3)
unit_z_5 = UnitZ(Factor=1)
cap_holes_3 = CapHoles(Brep=extrude_3)
amplitude_4 = Amplitude(Vector=unit_z_5, Amplitude=Slider(0.11811, range=0..1))
solid_difference_4 = SolidDifference(BrepsA=brep, BrepsB=cap_holes_3)
extrude_4 = Extrude(Base=join_curves_4, Direction=amplitude_4)
brep_4 = Brep(solid_difference_4)
cap_holes_4 = CapHoles(Brep=extrude_4)
# DISTANCE BETWEEN THE HINGE HOLES
number_slider_10 = Slider(0.12, range=0..1)
solid_difference_5 = SolidDifference(BrepsA=brep_3, BrepsB=cap_holes_4)
# DISTANCE FROM LENGTH EDGE
# DISTANCE FROM WIDTH EDGE
number_slider_11 = Slider(0.89, range=0..1)
number_slider_12 = Slider(0.15, range=0..1)
brep_5 = Brep(solid_difference_5)
deconstruct_brep_8 = DeconstructBrep(Brep=brep_5)  # -> Faces, Edges, Vertices
addition = Addition(A=number_slider_12, B=number_slider_10)
list_item_6 = ListItem(List=deconstruct_brep_8.Faces, Index=Slider(4, range=0..10), Wrap=True)
construct_point = ConstructPoint(XCoordinate=number_slider_12, YCoordinate=number_slider_11, ZCoordinate=0)
construct_point_2 = ConstructPoint(XCoordinate=expr("1-x", addition), YCoordinate=number_slider_11, ZCoordinate=0)
construct_point_3 = ConstructPoint(XCoordinate=expr("1-x", number_slider_12), YCoordinate=number_slider_11, ZCoordinate=0)
construct_point_4 = ConstructPoint(XCoordinate=addition, YCoordinate=number_slider_11, ZCoordinate=0)
evaluate_surface = EvaluateSurface(Surface=reparameterize(list_item_6), Point=construct_point)  # -> Point, Normal, UDirection, VDirection, Frame
evaluate_surface_2 = EvaluateSurface(Surface=reparameterize(list_item_6), Point=construct_point_4)  # -> Point, Normal, UDirection, VDirection, Frame
evaluate_surface_3 = EvaluateSurface(Surface=reparameterize(list_item_6), Point=construct_point_2)  # -> Point, Normal, UDirection, VDirection, Frame
evaluate_surface_4 = EvaluateSurface(Surface=reparameterize(list_item_6), Point=construct_point_3)  # -> Point, Normal, UDirection, VDirection, Frame
# 3mm (0.11811in) holes for hinges
number_slider_13 = Slider(0.11811, range=0..1)
circle_cnr_5 = CircleCNR(
    Center=[evaluate_surface.Point, evaluate_surface_2.Point, evaluate_surface_4.Point, evaluate_surface_3.Point],
    Normal=Vector(0, 0, 1),
    Radius=number_slider_13)
unit_z_6 = UnitZ(Factor=1)
amplitude_5 = Amplitude(Vector=unit_z_6, Amplitude=Slider(0.05044, range=0..1))
extrude_5 = Extrude(Base=circle_cnr_5, Direction=amplitude_5)
cap_holes_5 = CapHoles(Brep=extrude_5)
solid_difference_6 = SolidDifference(BrepsA=brep_5, BrepsB=cap_holes_5)
brep_6 = Brep(solid_difference_6)
